% Requirement links of Requisitos_NASH_Planta_MCP_ER_Prop_V1e_.slreqx (R2020a)

#26 implements #16: 001-F-MCP-009: Os valores dos sinais de temperatura de exaustão (MCPBE0.21 a 26) devem possuir dinâmica linear de 1a ordem baseada nos dados do IPQM-REL-156.
#27 implements #23: 001-F-MCP-016: O comportamento do sinal da temperatura da água de resfriamento(MCPBE0.19) deve ser implementado por uma TF de primeira ordem de regime estacionário entre Tambiente e 90°C de acordo com dados do EST-270.
#28 implements #7: 001-F-MCP-006: No estado de motor rodando, o modelo do MCP deve representar a dinâmica de rotação do motor de acordo com a demanda e com o estado da engrenagem reversora.
#28 implements #8: 001-F-MCP-007: A dinâmida de rotação do modelo do MCP deve apresentar o comportamento do motor representado no EST-156.
#29 implements #24: 001-F-MCP-017: O sinal simulado de pressão de boost (MCPBE0.20) do MCPBE deve ser um sinal constante (0 MPa em unidade de engenharia), de acordo com YANMAR,2003.
#30 implements #4: 001-F-MCP-003: No estado do motor desligado, o modelo do MCP deve ignorar comandos de demanda de rotação.
#30 implements #5: 001-F-MCP-004: No estado de motor parado, o modelo do MCP deve representar o valor de rotação igual a 0 RPM.